# Grasshopper definition mushroomVillage.gh (Grasshopper 1.0.7)

# ----
# Simple Recursion
number_slider = Slider(0.7, range=0.1..0.9)
crv = Curve(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)
Z = UnitZ(Factor=1)
python = GhPythonScript(branch=crv, scale=number_slider, angle=Slider(90, range=0..100), axis=Z, gen=Slider(10, range=1..10))  # -> out, a; inputs branch: Curve, angle: Int32, axis: Vector3d, gen: Int32
# ---------- python: Python ----------
import rhinoscriptsyntax as rs
#Recursive Tree

output = []

def tree(branch, angle, scale, axis, gen):
    if gen > 0:
        start_pt = rs.CurveStartPoint(branch)
        end_pt = rs.CurveEndPoint(branch)
        
        vec = rs.VectorCreate(end_pt, start_pt)
        vecS = rs.VectorScale(vec, scale)
        vecA = rs.VectorRotate(vecS, angle, axis)
        vecB = rs.VectorRotate(vecS, -angle, axis)
        endA = rs.VectorAdd(end_pt, vecA)
        endB = rs.VectorAdd(end_pt, vecB)
        lineA = rs.AddLine(end_pt, endA)
        lineB = rs.AddLine(end_pt, endB)
        
        tree(lineA, angle, scale, axis, gen-1)
        tree(lineB, angle, scale, axis, gen-1)
        output.append(lineA)
        output.append(lineB)
    
tree(branch, angle, scale, axis, gen)

a = output
# ---------- end python ----------
crv_2 = Curve(python.a)

# ----
# L-system Dragon curve
number_slider_2 = Slider(1, range=0..1.5)
number_slider_3 = Slider(0.9, range=0..1.5)
number_slider_4 = Slider(1, range=0..1.5)
number_slider_5 = Slider(1, range=0..1.5)
number_slider_6 = Slider(-11, range=-90..90)
crv_3 = Curve(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)
python_2 = GhPythonScript(
    branch=crv_3,
    scale=number_slider_2,
    A=Slider(90, range=-90..90),
    B=Slider(90, range=-90..90),
    gen=Slider(14, range=0..15))  # -> out, a; inputs branch: Curve, A: Int32, B: Int32, gen: Int32
# ---------- python_2: Python ----------
import rhinoscriptsyntax as rs

#dragon curve
#(F → F+G), (G → F-G)

output = []
pt = []

def dragon_curve_rule(gen, rule_set):
    if gen == 0:
        return rule_set
    gen -= 1
    new_total = []
    for rule in rule_set:
        if rule == "F":
            new_total.extend(["F", "G"])
                
        if rule == "G":
            new_total.extend(["F", "-G"])
            
        if rule == "-G":
            new_total.extend(["-F", "G"])
        
        if rule == "-F":
            new_total.extend(["-F", "-G"])
            
    return dragon_curve_rule(gen, new_total)

def dragon_curve_draw(branch, scale, gen, rule):
        sequence = dragon_curve_rule(gen, rule)
        print(sequence)
        start_pt = rs.CurveStartPoint(branch)
        end_pt = rs.CurveEndPoint(branch)
        vecA = rs.VectorCreate(end_pt, start_pt)
        
        vecS = rs.VectorScale(vecA, scale)
        
        axisX = [1, 0, 0]
        axisY = [0, 1, 0]
        axisZ = [0, 0, 1]
        
        for rule in sequence:
            vecS = rs.VectorScale(vecA, scale)
            if rule == "F" or rule == "G" :
                angle1, angle2, angle3 = rotation(rule)
#                vecA = rs.VectorRotate(vecS, angle1, axisX)  # Rotate around X-axis
#                vecA = rs.VectorRotate(vecA, angle2, axisY)  # Rotate around Y-axis
                vecA = rs.VectorRotate(vecA, angle3, axisZ)  # Rotate around Z-axis
                endA = rs.VectorAdd(end_pt, vecA)
                lineA = rs.AddLine(end_pt, endA)
                end_pt = rs.CurveEndPoint(lineA)
                output.append(lineA)

            if rule == "-G" or rule == "-F":
                angle1, angle2, angle3 = rotation(rule)
#                vecA = rs.VectorRotate(vecS, -angle1, axisX)  # Rotate around X-axis
#                vecA = rs.VectorRotate(vecA, -angle2, axisY)  # Rotate around Y-axis
                vecA = rs.VectorRotate(vecA, -angle3, axisZ)  # Rotate around Z-axis
                endA = rs.VectorAdd(end_pt, vecA)
                lineA = rs.AddLine(end_pt, endA)
                end_pt = rs.CurveEndPoint(lineA)
                output.append(lineA)
            print(end_pt)
        return output


def rotation(rule):
    if rule == "F" or rule == "-F":
        angle1 = 0 
        angle2 = 0  
        angle3 = A  

    if rule == "G" or rule == "-G":
        angle1 = 0
        angle2 = 0
        angle3 = B

    return angle1, angle2, angle3

dragon_curve_draw(branch, scale, gen, ["F"])
a = output
# ---------- end python_2 ----------
crv_4 = Curve(python_2.a)

# ----
# Recursion Dragon curve_ additional angle
number_slider_7 = Slider(4, range=0..15)
crv_5 = Curve(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)
python_3 = GhPythonScript(branch=crv_5, scale=Slider(1, range=0..1.5), angle=Slider(90, range=-90..90), gen=number_slider_7)  # -> flatten(out), outputA, outputB; inputs branch: Curve, angle: Int32, gen: Int32
# ---------- python_3: Python ----------
import rhinoscriptsyntax as rs
import math

outputA = []
outputB = []
pt = []
print(angle)

def deleteNull(output):
    i = 0 
    while i < len(output):
        if type(output[i]) == list :
            del output[i]
        elif type(output[i]) == tuple :
            del output[i]
        else:
            i += 1
    return output
        

def dragon_curve(start_pt, end_pt, scale, gen, sign):
    if gen == 0:
        line = rs.AddLine(start_pt, end_pt)
        return line
    else:

        if gen % 6 == 0:
            axis = [0, 1, 0]
            if sign == 0: #reverse list for joinery order
                axis = [0, -1, 0]
        else:
            axis = [0, 0, 1]
            if sign == 0: #reverse list for joinery order
                axis = [0, 0, -1]
        
        mid_pt = rs.VectorAdd(start_pt, end_pt)
        mid_pt = rs.VectorScale(mid_pt, 0.5)
        
        vecA = rs.VectorCreate(mid_pt, end_pt)
        vecA = rs.VectorRotate(vecA, angle, axis)
        vecA = rs.VectorAdd(mid_pt, vecA) #pointing the new mid_pt
        
        newA = dragon_curve(start_pt, vecA, scale, gen-1, 1)
        newB = dragon_curve(vecA, end_pt, scale, gen-1, 0)
        outputA.append(newA)
        outputB.append(newB)
        return outputA, outputB


start_pt = rs.CurveStartPoint(branch)
end_pt = rs.CurveEndPoint(branch)
#new_pt = rs.VectorAdd(start_pt, end_pt) #protect downsizing
#new_pt = rs.VectorScale(new_pt, gen * math.sqrt(2)) #fix it
#end_pt = new_pt
outputA, outputB = dragon_curve(start_pt, end_pt, scale, gen, 1)
deleteNull(outputA)
deleteNull(outputB)

#delete uncessary parts
# ---------- end python_3 ----------

# ----
# Rule-Based Recursion
number_slider_8 = Slider(1, range=0..1.5)
crv_6 = Curve(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)
python_4 = GhPythonScript(
    branch=crv_6,
    scale=number_slider_8,
    scaleA=Slider(0.9, range=0..1.5),
    scaleB=Slider(1, range=0..1.5),
    scaleC=Slider(1, range=0..1.5),
    A=Slider(3, range=-90..90),
    B=Slider(-90, range=-90..90),
    C=Slider(-11, range=-90..90),
    gen=Slider(17, range=0..100))  # -> out, a; inputs branch: Curve, A: Int32, B: Int32, C: Int32, gen: Int32
# ---------- python_4: Python ----------
import rhinoscriptsyntax as rs

output = []
pt = []

def tree(branch, A, B, C, scale, gen, type):
    if gen > 0:
        start_pt = rs.CurveStartPoint(branch)
        end_pt = rs.CurveEndPoint(branch)
        vec = rs.VectorCreate(end_pt, start_pt)
        vecS = rs.VectorScale(vec, scale)
        pt.append(start_pt)
        
        if type == "A":
            angle1, angle2, angle3, axisX, axisY, axisZ = rotation(type)
            vecS = rs.VectorScale(vec, scaleA)
            vecA = rs.VectorRotate(vecS, angle1, axisX)  # Rotate around X-axis
            vecA = rs.VectorRotate(vecA, angle2, axisY)  # Rotate around Y-axis
            vecA = rs.VectorRotate(vecA, angle3, axisZ)  # Rotate around Z-axis
            endA = rs.VectorAdd(end_pt, vecA)
            lineA = rs.AddLine(end_pt, endA)
            output.append(lineA)
            tree(lineA, A, B, C, scale, gen-1, "A")
            
            # Second branch for type A
            vecA = rs.VectorRotate(vecS, angle1, axisX)
            vecA = rs.VectorRotate(vecA, angle2, axisY)
            vecA = rs.VectorRotate(vecA, angle3, axisZ)
            endA = rs.VectorAdd(end_pt, vecA)
            lineA = rs.AddLine(end_pt, endA)
            output.append(lineA)
            tree(lineA, A, B, C, scale, gen-1, "B")
        
        if type == "B":
            angle1, angle2, angle3, axisX, axisY, axisZ = rotation(type)
            
            vecS = rs.VectorScale(vec, scaleB)
            vecB = rs.VectorRotate(vecS, angle1, axisX)
            vecB = rs.VectorRotate(vecB, angle2, axisY)
            vecB = rs.VectorRotate(vecB, angle3, axisZ)
            endB = rs.VectorAdd(end_pt, vecB)
            lineB = rs.AddLine(end_pt, endB)
            output.append(lineB)
            tree(lineB, A, B, C, scale, gen-1, "C")
            
        if type == "C":
            angle1, angle2, angle3, axisX, axisY, axisZ = rotation(type)
            vecS = rs.VectorScale(vec, scaleC)
            vecC = rs.VectorRotate(vecS, angle1, axisX)
            vecC = rs.VectorRotate(vecC, angle2, axisY)
            vecC = rs.VectorRotate(vecC, angle3, axisZ)
            endC = rs.VectorAdd(end_pt, vecC)
            lineC = rs.AddLine(end_pt, endC)
            output.append(lineC)
            tree(lineC, A, B, C, scale, gen-1, "A")

def rotation(type):
    if type == "A":
        angle1 = 0 
        angle2 = A  
        angle3 = 0  
        axisX = [1, 0, 0]
        axisY = [0, 1, 0]
        axisZ = [0, 0, 1]
    if type == "B":
        angle1 = 0
        angle2 = 0
        angle3 = B
        axisX = [1, 0, 0]
        axisY = [0, 1, 0]
        axisZ = [0, 0, 1]
    if type == "C":
        angle1 = C
        angle2 = 0
        angle3 = 0
        axisX = [1, 0, 0]
        axisY = [0, 1, 0]
        axisZ = [0, 0, 1]
    return angle1, angle2, angle3, axisX, axisY, axisZ

tree(branch, A, B, C, scale, gen, "A")
a = output
# ---------- end python_4 ----------
crv_7 = Curve(python_4.a)

# ----
# Recursion Dragon curve(Simple)
number_slider_9 = Slider(1, range=0..1.5)
crv_8 = Curve(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)
python_5 = GhPythonScript(branch=crv_8, scale=number_slider_9, angle=Slider(90, range=-90..90), gen=Slider(1, range=0..15))  # -> flatten(out), a; inputs branch: Curve, angle: Int32, gen: Int32
# ---------- python_5: Python ----------
import rhinoscriptsyntax as rs
import math

output = []
pt = []

def dragon_curve(start_pt, end_pt, scale, gen):
    if gen == 0:
        line = rs.AddLine(start_pt, end_pt)
        return line
    else:
        
        axisX = [1, 0, 0]
        axisY = [0, 1, 0]
        axisZ = [0, 0, 1]
        
        mid_pt = rs.VectorAdd(start_pt, end_pt)
        mid_pt = rs.VectorScale(mid_pt, 0.5)
        
        vecA = rs.VectorCreate(mid_pt, end_pt)
        vecA = rs.VectorRotate(vecA, angle, axisZ)
        vecA = rs.VectorAdd(mid_pt, vecA) #pointing the new mid_pt
        
        newA = dragon_curve(start_pt, vecA, scale, gen-1)
        newB = dragon_curve(end_pt, vecA, scale, gen-1)
        output.append(newA)
        output.append(newB)
        return output


start_pt = rs.CurveStartPoint(branch)
end_pt = rs.CurveEndPoint(branch)
new_pt = rs.VectorAdd(start_pt, end_pt) #protect downsizing
new_pt = rs.VectorScale(new_pt, gen * math.sqrt(2)) #fix it
end_pt = new_pt
dragon_curve(start_pt, end_pt, scale, gen)

#delete uncessary parts
i = 0 
while i < len(output):
    if type(output[i]) == list:
        del output[i]
    else:
        i += 1

a = output
# ---------- end python_5 ----------
crv_9 = Curve(python_5.a)

crv_10 = Curve(python_3.outputB)
crv_11 = Curve(python_3.outputA)
merge = Merge(Data1=crv_11, Data2=crv_10)
len = Length(Curve=merge)
sort = SortList(Keys=len, ValuesA=merge)  # -> Keys, ValuesA
sort_2 = SortList(Keys=len, ValuesA=len)  # -> Keys, ValuesA
dcon = DeleteConsecutive(Set=sort_2.ValuesA, Wrap=False)  # -> Set, Count
mindex = MemberIndex(Set=sort_2.ValuesA, Member=dcon.Set)  # -> Index, Count
item = ListItem(List=sort.ValuesA, Index=mindex.Index, Wrap=True)  # -> simplify(Item)
viewer = ParamViewer(item)
split = SplitList(List=viewer, Index=2)  # -> ListA, ListB
branch = TreeBranch(Tree=item, Path=split.ListA, MaintainPaths=True)  # -> flatten(Branch)

crv_12 = Curve(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)
brep = Brep(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)
end = EndPoints(Curve=crv_12)  # -> Start, End
len_2 = Length(Curve=crv_12)
item_2 = ListItem(List=len_2, Index=0, Wrap=True)
len_3 = Length(Curve=branch)
division = Division(A=len_3, B=item_2)
scale = Scale(Geometry=brep, Center=end.Start, Factor=division)  # -> Geometry, Transform

branch_2 = TreeBranch(Tree=item, Path=split.ListB, MaintainPaths=True)  # -> flatten(Branch)

crv_13 = Curve(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)
brep_2 = Brep(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)
end_2 = EndPoints(Curve=crv_13)  # -> Start, End
len_4 = Length(Curve=crv_13)
len_5 = Length(Curve=branch_2)
division_2 = Division(A=len_5, B=len_4)
scale_2 = Scale(Geometry=brep_2, Center=end_2.Start, Factor=division_2)  # -> Geometry, Transform

orient = Orient(Geometry=scale.Geometry, Source=crv_12, Target=branch)  # -> Geometry, Transform
orient_2 = Orient(Geometry=scale_2.Geometry, Source=crv_13, Target=branch_2)  # -> Geometry, Transform
number_slider_10 = Slider(5, range=0..17)
debrep = DeconstructBrep(Brep=orient.Geometry)  # -> Faces, Edges, Vertices
panel = Panel("""4
2""")
mesh = MeshBrep(
    Brep=orient_2.Geometry,
    Settings={GridMaxCount=0, GridMinCount=16, JaggedSeams=False, MaxEdgeLength=0, MinEdgeLength=0.0001, MinTolerance=0, Refine=True, RefineAngle=0, RelativeTolerance=0.65, SimplePlanes=True, Tolerance=0})
dispatch = Dispatch(List=mesh, DispatchPattern=[True, False])  # -> ListA, ListB
cull_i = CullIndex(List=debrep.Faces, Indices=[number_slider_10, panel], Wrap=True)
item_3 = ListItem(List=debrep.Faces, Index=number_slider_10, Wrap=True)
item_4 = ListItem(List=debrep.Faces, Index=panel, Wrap=True)
mesh_2 = MeshBrep(
    Brep=cull_i,
    Settings={GridMaxCount=0, GridMinCount=16, JaggedSeams=False, MaxEdgeLength=0, MinEdgeLength=0.0001, MinTolerance=0, Refine=True, RefineAngle=0, RelativeTolerance=0.65, SimplePlanes=True, Tolerance=0})
mesh_3 = MeshBrep(
    Brep=item_3,
    Settings={GridMaxCount=0, GridMinCount=16, JaggedSeams=False, MaxEdgeLength=0, MinEdgeLength=0.0001, MinTolerance=0, Refine=True, RefineAngle=0, RelativeTolerance=0.65, SimplePlanes=True, Tolerance=0})
mesh_4 = MeshBrep(
    Brep=item_4,
    Settings={GridMaxCount=0, GridMinCount=16, JaggedSeams=False, MaxEdgeLength=0, MinEdgeLength=0.0001, MinTolerance=0, Refine=True, RefineAngle=0, RelativeTolerance=0.65, SimplePlanes=True, Tolerance=0})
preview = CustomPreview(Geometry=[mesh_3, dispatch.ListA], Material=ColourSwatch(SwatchColor=RGB(227, 223, 154)))
preview_2 = CustomPreview(Geometry=dispatch.ListB, Material=ColourSwatch(SwatchColor=RGB(237, 192, 152)))
preview_3 = CustomPreview(Geometry=mesh_4, Material=ColourSwatch(SwatchColor=RGB(237, 189, 180)))
preview_4 = CustomPreview(Geometry=mesh_2, Material=ColourSwatch(SwatchColor=RGB(170, 206, 230)))
