# Grasshopper definition jsohyun_life of drawing.gh (Grasshopper 1.0.7)

# ---- group: Image sampler (Grid)
number_slider = Slider(100, range=0..100)
number_slider_2 = Slider(150, range=0..1000)
xy = XYPlane(Origin=Point(0, 0, 0))
X = UnitX(Factor=number_slider_2)
rectangle = Rectangle(Plane=xy, XSize=number_slider, YSize=number_slider, Radius=0)  # -> Rectangle, Length
cell_number = Slider(65, range=0..100)
move = Move(Geometry=rectangle.Rectangle, Motion=X)  # -> Geometry, Transform
sdivide = DivideSurface(Surface=move.Geometry, UCount=cell_number, VCount=cell_number)  # -> Points, Normals, Parameters
srf_cp = SurfaceClosestPoint(Point=sdivide.Points, Surface=reparameterize(move.Geometry))  # -> Point, UVPoint, Distance
evalsrf = EvaluateSurface(Surface=move.Geometry, Point=srf_cp.UVPoint)  # -> Point, Normal, UDirection, VDirection, Frame
panel = Panel(srf_cp.Point)
image = ImageSampler(
    srf_cp.UVPoint,
    FilePath="C:\Users\DELL G5\Desktop\myself3.jpg",
    Filter="Value",
    Interpolate=True,
    Umax=1,
    Umin=0,
    Vmax=1,
    Vmin=0,
    Wrap=1)

# ----
panel_2 = Panel(image)
drawing_start = BooleanToggle(True)
python = GhPythonScript(click=Slider(7, range=0..10), x=drawing_start, y=rectangle.Rectangle, length=number_slider, move_to=number_slider_2)  # -> out, lines; inputs click: Int32, x: Boolean, y: Rectangle3d, length: Int32
# ---------- python: Python ----------
import rhinoscriptsyntax as rs
import Rhino
import System.Drawing.Color
import math

click 
#boundary
w = length
h = length
d = move_to
print(d, d + w, h)

def CustomPerpLine(point_a, i, points, pointer_color):
    # DynamicDraw event occurs
    def GetPointDynamicDrawFunc( sender, args ):
        point_b = args.CurrentPoint
#        args.Display.DrawLine(point_a, point_b, pointer_color, 3)
        args.Display.DrawPolyline(points + [point_b], pointer_color, 3)
        args.Display.DrawCircle(Rhino.Geometry.Circle(point_b, 2), pointer_color, 1)
        line = Rhino.Geometry.Line(point_a, point_b)
        
    #reference: https://discourse.mcneel.com/t/dynamic-drawing-of-lines-based-on-chosen-points/2199
    
    gp = Rhino.Input.Custom.GetPoint()
    gp.DynamicDraw += GetPointDynamicDrawFunc
    gp.Get()
    if( gp.CommandResult() == Rhino.Commands.Result.Success ):
       
        pt = gp.Point()
        x = pt[0]
        y = pt[1]
        if d < x < d + w and d < y <  h: 
            print(x, y, d, d+w, d + h)
            line = rs.AddLine(point_a, pt)
            return pt, line
        else:
            print("Please draw in the boundary area", x, y, d, d+w, d + h)
            return None, None


lines =[]
#if( __name__ == "__main__" ):
if x == True:
    point_a = rs.GetPoint("Please insert next points")
    pts = [point_a]

    if point_a:
        for i in range(click):
            
            pointer_color = System.Drawing.Color.FromArgb(255,0,0)
            if len(pts) == click:
                pointer_color = System.Drawing.Color.FromArgb(0,255,0)
                
            point_a, line = CustomPerpLine(point_a, i, pts, pointer_color)
            
            if point_a: 
                pts.append(point_a)
            if line: 
                lines.append(line)
# ---------- end python ----------
stroke_width = Slider(1, range=0..10)

line = Line(graft(python.lines))  # disabled
division = Division(A=number_slider, B=cell_number)
pt = Point(flatten(srf_cp.Point))
crv_cp = CurveClosestPoint(Point=pt, Curve=line)  # -> Point, Parameter, Distance
smaller = SmallerThan(FirstNumber=crv_cp.Distance, SecondNumber=stroke_width)  # -> SmallerThan, OrEqualTo
sift = SiftPattern(List=crv_cp.Point, SiftPattern=smaller.OrEqualTo)  # -> Output0, Output1
pt_2 = Point(sift.Output1)
cull = CullPattern(List=pt, CullPattern=pt_2)

cell_unit = Panel(division)

# ---- group: Image effect
number_slider_3 = Slider(4, range=0..10)
A = Slider(0.1, range=0..1)
B = Slider(0.4, range=0..1)
dom = ConstructDomain(DomainStart=A, DomainEnd=B)
merge = Merge(
    Data1=ColourSwatch(SwatchColor=RGB(255, 0, 0)),
    Data2=ColourSwatch(SwatchColor=RGB(111, 196, 79)),
    Data3=ColourSwatch(SwatchColor=RGB(0, 0, 174)),
    Data4=ColourSwatch(SwatchColor=RGB(251, 224, 0)))
range = Range(Domain=dom, Steps=expr("x-1", number_slider_3))
div = DivideDomain(Domain=Domain(0, 1), Count=number_slider_3)
fdom = FindDomain(Domains=div, Number=image, Strict=False)  # -> Index, Neighbour
item = ListItem(List=range, Index=fdom.Index, Wrap=True)
item_2 = ListItem(List=merge, Index=fdom.Index, Wrap=True)
circle = CircleCNR(Center=srf_cp.Point, Normal=evalsrf.Normal, Radius=item)
preview = CustomPreview(
    Geometry=circle,
    Material={diffuse=RGB(221, 160, 221), emission=RGB(66, 48, 66), shine=0.5, specular=RGB(255, 255, 255), transparency=0})

# ----
fdom_2 = FindDomain(Domains=div, Number=image, Strict=False)  # -> Index, Neighbour
fdom_3 = FindDomain(Domains=div, Number=image, Strict=False)  # -> Index, Neighbour
item_3 = ListItem(List=merge, Index=fdom_2.Index, Wrap=True)
item_4 = ListItem(List=merge, Index=fdom_3.Index, Wrap=True)
panel_3 = Panel(item_3)
panel_4 = Panel(item_4)
panel_5 = Panel(item_2)

# ---- group: Sorted 1D data / cellsize
num = Number(cell_number)

# ---- group: Sorted 1D data / 1D List Radius
data = Data(flatten(item))

# ---- group: Sorted 1D data / 1D List Points
pt_3 = Point(pt)

# ---- group: Sorted 1D data / 1D Nearest points
flatten = FlattenTree(Tree=cull, Path="{0}")
mindex = MemberIndex(Set=pt_3, Member=flatten)  # -> flatten(Index), Count
item_5 = ListItem(List=pt_3, Index=mindex.Index, Wrap=True)

# ---- group: Sorted 1D data / Point positions
flatten_2 = FlattenTree(Tree=srf_cp.Point, Path="{0}")

# ---- group: Sorted 1D data
addition = Addition(A=num, B=1)
panel_6 = Panel(addition)

# ----
viewer = ParamViewer(mindex.Index)
panel_7 = Panel(data)
multiplication = Multiplication(A=data, B=1.5)
select_2a_unslect_2b = BooleanToggle(True)
mode_1_start = BooleanToggle(False)
mode_2_start = BooleanToggle(True)
circle_2 = CircleCNR(Center=item_5, Normal=evalsrf.Normal, Radius=multiplication)

# ---- group: Rule: Cellular Automata
python_2 = GhPythonScript(x=mode_1_start, radius=multiplication, points=flatten_2, drawing_index=mindex.Index, cols=panel_6, num_generation="15")  # -> out, temp_circles, simplify(lives), simplify(death); inputs radius: list, points: list, drawing_index: list, cols: Int32, num_generation: Int32
# ---------- python_2: Python ----------
import rhinoscriptsyntax as rs
import random
from copy import deepcopy 
import ghpythonlib.treehelpers as th


rs.DefaultRenderer(False)
rs.EnableRedraw(False) 

###parameters####
drawing_index # chosen points by drawings!!!!
radius #1D list, index size
points #1D list, index size
num_generation #for implementation

cell_size = cols * cols #col x row
states = {} #{ point: 1 or 0 } 

##inactivated due to Grasshopper env.
##create circle from information 
##allocated_circles, mark live circle
#circles = [] #1D list, index size
#for i in range(cell_size):
#    c = rs.AddCircle(points[i], radius[i])
#    circles.append(c)

for i in range(cell_size): #save initial states
    if i in drawing_index:
        states[points[i]] = 1
    else:
        states[points[i]] = 0

###functions####
def count_lives(dict):
    sum = 0
    for i in range(len(dict)):
        sum += dict[points[i]]
    return sum

def get_neighbors_indices(index, cols): #1D index of surrounding points
    neighbors = []
    surroundings =[index + cols -1, index + cols, index + cols + 1,
                index - cols -1, index - cols, index - cols + 1, 
                index -1, index +1] 
    for neighbor in surroundings:
         if 0 <= neighbor < len(states):
            neighbors.append(neighbor)
    return neighbors
        
def count_neighbors(index, states): #
    sum_neighbors = 0

    index_neighbors = get_neighbors_indices(index, cols)
    for i in index_neighbors:
        sum_neighbors += states[points[i]] 

    return sum_neighbors

#rule 1
def game_of_life_grid(states): # update recursive phase
    count = 0
    new_states = {}
    for i in range(cell_size):
        neighbors = count_neighbors(i, states)
        pt = points[i] 
        state = states[pt]

        if state == 0 and neighbors == 3:  # A dead cell becomes alive
            new_states[points[i]] = 1

        elif state == 1 and (neighbors < 2 or neighbors > 3):  # A live cell dies
            new_states[points[i]] = 0

        elif state == 1:
            new_states[points[i]] = 1
            
        elif state == 0:
            new_states[points[i]] = 0
#    print(count_lives(new_states), count_lives(states))
    return new_states

def disassemble_dict(dict, num):
    list = []
    for i in range(len(dict)):
        if dict[points[i]] == num:
            list.append(i)
    return list
        

###implementation####
data_l = []
data_d = []
if x == True:
    live = disassemble_dict(states, 1) ##save initial values
    death = disassemble_dict(states, 0) ##save initial values
    data_l.append(live)
    data_d.append(death)
    
    for i in range(num_generation):
        states = game_of_life_grid(states)
        
        live = disassemble_dict(states, 1)
        death = disassemble_dict(states, 0)
        data_l.append(live)
        data_d.append(death)
        
    
    lives = th.list_to_tree(data_l)
    death = th.list_to_tree(data_d)

print("rule1 grid generated")
# ---------- end python_2 ----------

# ---- group: Rule: Ripple Effect
python_3 = GhPythonScript(
    x=mode_2_start,
    radius=multiplication,
    points=flatten_2,
    drawing_index=mindex.Index,
    cols=panel_6,
    num_generation="15",
    mode=select_2a_unslect_2b)  # -> out, temp_circles, simplify(lives), simplify(death), simplify(over_live); inputs radius: list, points: list, drawing_index: list, cols: Int32, num_generation: Int32
# ---------- python_3: Python ----------
import rhinoscriptsyntax as rs
import random
from copy import deepcopy 
import ghpythonlib.treehelpers as th


rs.DefaultRenderer(False)
rs.EnableRedraw(False) 

###parameters####
drawing_index # chosen points by drawings!!!!
radius #1D list, index size
points #1D list, index size
num_generation #for implementation

cell_size = cols * cols #col x row
states = {} #{ point: 1 or 0 } 
live_archive = []

def check_state(cell_size, index, dict, points):
    for i in range(cell_size):
        if i in index:
            dict[points[i]] = 1
            live_archive.append(points[i])
        else:
            dict[points[i]] = 0
    return dict

###functions####
def count_lives(dict):
    sum = 0
    for i in range(len(dict)):
        sum += dict[points[i]]
    return sum

def get_neighbors_indices(index, cols): #1D index of surrounding points
    neighbors = []
    surroundings =[index + cols -1, index + cols, index + cols + 1,
                index - cols -1, index - cols, index - cols + 1, 
                index -1, index +1] 
    for neighbor in surroundings:
         if 0 <= neighbor < len(states):
            neighbors.append(neighbor)
    return neighbors
    
def count_neighbors(index, states): #
    sum_neighbors = 0

    index_neighbors = get_neighbors_indices(index, cols)
    for i in index_neighbors:
        sum_neighbors += states[points[i]] 

    return sum_neighbors
    
def get_far_indices(index, cols): #1D index of surrounding points
    neighbors = []
    surroundings =[index + 2*cols -2, index + 2*cols -1, index + 2*cols, index + 2*cols + 1, index + 2*cols +2,
                index - 2*cols - 2, index - 2*cols -1, index - 2*cols, index - 2*cols + 1, index - 2*cols + 2,
                index + cols - 2, index + cols + 2,
                index - cols - 2, index - cols + 2,
                index -2, index + 2] 
    for neighbor in surroundings:
         if 0 <= neighbor < len(states):
            neighbors.append(neighbor)
    return neighbors
    
def count_far_neighbors(index, states):
    sum_neighbors = 0
    
    index_neighbors = get_far_indices(index, cols)
    for i in index_neighbors:
        sum_neighbors += states[points[i]]
               
    return sum_neighbors
    
def polarize_neighbors(index, states): #
    index_neighbors = get_neighbors_indices(index, cols) + get_far_indices(index, cols)

    if count_neighbors(index, states) >= 2 or count_far_neighbors(index, states) >= 2:
        for i in index_neighbors:
            if (index * 2 - i) in index_neighbors: #if polarized, the mid is index
                return True
    return False
    
    
#rule 2
def ripple_grid(states): # update recursive phase
    previous_states = dict(states) #copy dict
    states = {}
    
    for i in range(cell_size):
        neighbors = count_neighbors(i, previous_states)
        polar = polarize_neighbors(i, previous_states)
        pt = points[i] 
        previous = previous_states[points[i]]
        
        if mode == True:
            if previous == 0 and pt not in live_archive and neighbors != 0: #neighbor triggers
                states[pt] = 1
                live_archive.append(pt)
                
            elif previous == 0 and  pt not in live_archive and polar == True: #wave overlays
                states[pt] = 2
                
            else:
                states[pt] = 0
        
        if mode == False:
            
            if previous == 0 and neighbors != 0: #neighbor triggers
                states[pt] = 1
                live_archive.append(pt)
                
            elif previous == 0 and  pt not in live_archive and polar == True: #wave overlays
                states[pt] = 2
                
            else:
                states[pt] = 0



            
    return states

def disassemble_dict(dict, num):
    list = []
    for i in range(len(dict)):
        if dict[points[i]] == num:
            list.append(i)
    return list


###implementation####
data_l = []
data_d = []
data_extra = []
states = check_state(cell_size, drawing_index, states, points)


if x == True:
    live = disassemble_dict(states, 1) ##save initial values
    death = disassemble_dict(states, 0) ##save initial values
    over_live = disassemble_dict(states, 2)
    data_l.append(live)
    data_d.append(death)
    data_extra.append(over_live)
    
    for i in range(num_generation):
        states = ripple_grid(states)
        
        over_live = disassemble_dict(states, 2)
        live = disassemble_dict(states, 1)
        death = disassemble_dict(states, 0)
        data_l.append(live)
        data_d.append(death)
        data_extra.append(over_live)
        
    lives = th.list_to_tree(data_l)
    death = th.list_to_tree(data_d)
    over_live = th.list_to_tree(data_extra)
# ---------- end python_3 ----------

# ----
iteration = Slider(0, range=0..10)
smaller_2 = SmallerThan(FirstNumber=iteration, SecondNumber="15")  # -> SmallerThan, OrEqualTo
panel_8 = Panel(smaller_2.SmallerThan)
concat = Concatenate(FragmentA="{", FragmentB=iteration)
concat_2 = Concatenate(FragmentA="{", FragmentB=iteration)
concat_3 = Concatenate(FragmentA=concat, FragmentB="}")
concat_4 = Concatenate(FragmentA=concat_2, FragmentB="}")
branch = TreeBranch(Tree=python_2.death, Path=concat_4, MaintainPaths=True)
branch_2 = TreeBranch(Tree=python_2.lives, Path=concat_4, MaintainPaths=True)
branch_3 = TreeBranch(Tree=python_3.death, Path=concat_3, MaintainPaths=True)
branch_4 = TreeBranch(Tree=python_3.lives, Path=concat_3, MaintainPaths=True)
branch_5 = TreeBranch(Tree=python_3.over_live, Path=concat_3, MaintainPaths=True)

item_6 = ListItem(List=data, Index=branch, Wrap=True)
multiplication_2 = Multiplication(A=item_6, B=1.5)

# ---- group: radius
item_7 = ListItem(List=data, Index=branch_3, Wrap=True)
multiplication_3 = Multiplication(A=item_7, B=1.5)

# ----
item_8 = ListItem(List=data, Index=branch_5, Wrap=True)
item_9 = ListItem(List=pt_3, Index=branch, Wrap=True)
item_10 = ListItem(List=pt_3, Index=branch_2, Wrap=True)

# ---- group: Coordinates
item_11 = ListItem(List=pt_3, Index=branch_4, Wrap=True)
item_12 = ListItem(List=pt_3, Index=branch_3, Wrap=True)
item_13 = ListItem(List=pt_3, Index=branch_5, Wrap=True)

# ----
multiplication_4 = Multiplication(A=item_8, B="2")
pt_4 = Point(item_10)
circle_3 = CircleCNR(Center=item_9, Normal=evalsrf.Normal, Radius=multiplication_2)
circle_4 = CircleCNR(Center=item_10, Normal=evalsrf.Normal, Radius="1")
circle_5 = CircleCNR(Center=item_13, Normal=evalsrf.Normal, Radius=multiplication_4)
circle_6 = CircleCNR(Center=item_11, Normal=evalsrf.Normal, Radius="0.1")

# ---- group: inactivate
circle_7 = CircleCNR(Center=item_12, Normal=evalsrf.Normal, Radius=multiplication_3)

# ----
preview_2 = CustomPreview(Geometry=circle_3, Material=ColourSwatch(SwatchColor=RGB(119, 166, 81)))
preview_3 = CustomPreview(Geometry=circle_4, Material=ColourSwatch(SwatchColor=RGB(50, 120, 61)))
preview_4 = CustomPreview(Geometry=circle_5, Material=ColourSwatch(SwatchColor=RGB(106, 2, 232)))
